# Dynamo graph ArchBridge.dyn (Dynamo 1.3.3.4651)

# group: Input
number_slider_bridge_start_width = DoubleSlider(8000, range=2500..10000 step 1)
number_slider_bridge_span = DoubleSlider(25000, range=0..50000 step 1)
number_slider_bridge_toog = DoubleSlider(1000, range=0..10000 step 1)
number_slider_bridge_middle = DoubleSlider(4000, range=0..10000 step 1)  # "Number Slider | Bridge Middle Width"
integer_slider_number_of_cables = IntegerSlider(18, range=0..30 step 1)
number_slider_bridge_arch_height = DoubleSlider(6000, range=0..25000 step 0.1)
number_slider_bridge_arch_swing = DoubleSlider(-2500, range=-6000..5000 step 1)
number_slider_bridge_deck = DoubleSlider(250, range=0..500 step 0.1)  # "Number Slider | Bridge Deck Thickness"
number_slider_arch_trim_length = DoubleSlider(5000, range=0..5000 step 1)
integer_slider_number_of_beams = IntegerSlider(7, range=0..10 step 1)

code_block = CodeBlock(width=number_slider_bridge_start_width, length=number_slider_bridge_span) { width/2..-width/2..#2; length/2..-length/2..#2; }
byCoordinates = Point.ByCoordinates(x=code_block.out1)
byCoordinates_2 = Point.ByCoordinates(z=number_slider_bridge_toog)
code_block_2 = CodeBlock { 1; }
insert = Insert(byCoordinates, byCoordinates_2, code_block_2)
code_block_3 = CodeBlock(width=number_slider_bridge_start_width) { width/2..-width/2..#2; }
code_block_4 = CodeBlock(width=number_slider_bridge_middle) { width/2..-width/2..#2; }
create = List.Create(code_block_3, code_block_4, code_block_3)
translate = Geometry.Translate(geometry=insert, yTranslation=create)
transpose = List.Transpose(translate)
byPoints = NurbsCurve.ByPoints(transpose)
code_block_5 = CodeBlock(count=integer_slider_number_of_cables) { 0.1..0.9..#count; }
pointAtParameter = Curve.PointAtParameter(curve=byPoints, param=code_block_5, lacing=CrossProduct)
byCoordinates_3 = Point.ByCoordinates(z=number_slider_bridge_arch_height)
insert_2 = Insert(byCoordinates, byCoordinates_3, code_block_2)
translate_2 = Geometry.Translate(geometry=insert_2, yTranslation=code_block.out0, lacing=CrossProduct)
code_block_6 = CodeBlock { 1; }
removeItemAtIndex = List.RemoveItemAtIndex(list=translate_2, indices=code_block_6)
code_block_7 = CodeBlock(IN=translate_2) { IN[1]; }
code_block_8 = CodeBlock(swing=number_slider_bridge_arch_swing) { swing/2..-swing/2..#2; }
translate_3 = Geometry.Translate(geometry=code_block_7, yTranslation=code_block_8)
insert_3 = Insert(removeItemAtIndex, translate_3, code_block_6)
transpose_2 = List.Transpose(insert_3)
byPoints_2 = NurbsCurve.ByPoints(transpose_2)
pointAtParameter_2 = Curve.PointAtParameter(curve=byPoints_2, param=code_block_5, lacing=CrossProduct)
byStartPointEndPoint = Line.ByStartPointEndPoint(startPoint=pointAtParameter, endPoint=pointAtParameter_2)

# group: Girder Input
number_slider_bridge_edge_girder = DoubleSlider(250, range=0..600 step 1)  # "Number Slider | Bridge Edge Girder Width"
number_slider_number_slider = DoubleSlider(600, range=0..600 step 1)  # "Number Slider | Number Slider | Bridge Edge Girder Height"

# group: Girder Cross Section
XZ = Plane.XZ()
byWidthLength = Rectangle.ByWidthLength(plane=XZ, width=number_slider_bridge_edge_girder, length=number_slider_number_slider)
code_block_9 = CodeBlock(x=number_slider_number_slider) { -x/2; }
translate_4 = Geometry.Translate(geometry=byPoints, zTranslation=code_block_9)
code_block_10 = CodeBlock { 0..1..#3; }
coordinateSystemAtParameter = Curve.CoordinateSystemAtParameter(translate_4, code_block_10, lacing=CrossProduct)
origin = CoordinateSystem.Origin(coordinateSystemAtParameter)
code_block_11 = CodeBlock { 1; }
code_block_12 = CodeBlock { 3; }
cycle = List.Cycle(list=code_block_11, amount=code_block_12)
create_2 = List.Create(cycle, cycle)
byCoordinates_4 = Vector.ByCoordinates(z=create_2)
YAxis = CoordinateSystem.YAxis(coordinateSystemAtParameter)
byOriginVectors = CoordinateSystem.ByOriginVectors(origin=origin, xAxis=byCoordinates_4, yAxis=YAxis, zAxis=byCoordinates_4)
transform = Geometry.Transform(byWidthLength, byOriginVectors, lacing=CrossProduct)

byLoft = Solid.ByLoft(transform)
byPoints_3 = PolyCurve.ByPoints(points=translate)
byLoft_2 = Surface.ByLoft(byPoints_3)
code_block_13 = CodeBlock { false; }
thicken = Surface.Thicken(surface=byLoft_2, thickness=number_slider_bridge_deck, both_sides=code_block_13)
code_block_14 = CodeBlock(c=byPoints, trim=number_slider_arch_trim_length) { length = c.Length; trimmedLength = length-trim; endParam = trimmedLength/length; startParam = 1-endParam; }
trimByParameter = Curve.TrimByParameter(byPoints_2, code_block_14.startParam, code_block_14.endParam)
code_block_15 = CodeBlock(count=integer_slider_number_of_beams) { 0..1..#count; }
pointAtParameter_3 = Curve.PointAtParameter(curve=trimByParameter, param=code_block_15, lacing=CrossProduct)
transpose_3 = List.Transpose(pointAtParameter_3)
byPoints_4 = PolyCurve.ByPoints(points=transpose_3)

# group: Arch Cross-section Input
number_slider_arch_cross_section = DoubleSlider(250, range=0..600 step 1)  # "Number Slider | Arch Cross-section Width"
number_slider_arch_cross_section_2 = DoubleSlider(500, range=0..600 step 1)  # "Number Slider | Arch Cross-section Height"

# group: Girder Cross Section
XZ_2 = Plane.XZ()
byWidthLength_2 = Rectangle.ByWidthLength(plane=XZ_2, width=number_slider_arch_cross_section, length=number_slider_arch_cross_section_2)
code_block_16 = CodeBlock { 0..1..#3; }
coordinateSystemAtParameter_2 = Curve.CoordinateSystemAtParameter(byPoints_2, code_block_16, lacing=CrossProduct)
origin_2 = CoordinateSystem.Origin(coordinateSystemAtParameter_2)
code_block_17 = CodeBlock { 1; }
code_block_18 = CodeBlock { 3; }
cycle_2 = List.Cycle(list=code_block_17, amount=code_block_18)
create_3 = List.Create(cycle_2, cycle_2)
byCoordinates_5 = Vector.ByCoordinates(z=create_3)
YAxis_2 = CoordinateSystem.YAxis(coordinateSystemAtParameter_2)
byOriginVectors_2 = CoordinateSystem.ByOriginVectors(origin=origin_2, xAxis=byCoordinates_5, yAxis=YAxis_2, zAxis=byCoordinates_5)
transform_2 = Geometry.Transform(byWidthLength_2, byOriginVectors_2, lacing=CrossProduct)

byLoft_3 = Solid.ByLoft(transform_2)
XZ_3 = Plane.XZ()

# group: Input Railing
number_slider_baluster_cross = DoubleSlider(35, range=0..35 step 1)  # "Number Slider | Baluster Cross-section Radius"
integer_slider_number_of = IntegerSlider(18, range=0..100 step 1)  # "Integer Slider | Number of Balusters"
number_slider_railing_height = DoubleSlider(1000, range=0..1000 step 1)
number_slider_hand_rail_cross = DoubleSlider(25, range=0..35 step 1)  # "Number Slider | Hand rail Cross section Radius"

byPlaneRadius = Circle.ByPlaneRadius(plane=XZ_3, radius=number_slider_baluster_cross)
code_block_19 = CodeBlock { -250..250..#2; }
translate_5 = Geometry.Translate(geometry=byPoints, yTranslation=code_block_19)
code_block_20 = CodeBlock(count=integer_slider_number_of) { 0.002..1-0.002..#count; }
pointAtParameter_4 = Curve.PointAtParameter(curve=translate_5, param=code_block_20, lacing=CrossProduct)
translate_6 = Geometry.Translate(geometry=pointAtParameter_4, zTranslation=number_slider_railing_height)
byStartPointEndPoint_2 = Line.ByStartPointEndPoint(startPoint=pointAtParameter_4, endPoint=translate_6)
coordinateSystemAtParameter_3 = Curve.CoordinateSystemAtParameter(byStartPointEndPoint_2)
transform_3 = Geometry.Transform(byPlaneRadius, coordinateSystemAtParameter_3)
sweepAsSolid = Curve.SweepAsSolid(transform_3, byStartPointEndPoint_2)
XZ_4 = Plane.XZ()
byPlaneRadius_2 = Circle.ByPlaneRadius(plane=XZ_4, radius=number_slider_hand_rail_cross)
translate_7 = Geometry.Translate(geometry=translate_5, zTranslation=number_slider_railing_height)
coordinateSystemAtParameter_4 = Curve.CoordinateSystemAtParameter(translate_7)
transform_4 = Geometry.Transform(byPlaneRadius_2, coordinateSystemAtParameter_4)
sweepAsSolid_2 = Curve.SweepAsSolid(transform_4, translate_7)
code_block_21 = CodeBlock { 100; }
translate_8 = Geometry.Translate(geometry=translate_5, zTranslation=code_block_21)
create_4 = List.Create(translate_8, translate_7)
transpose_4 = List.Transpose(create_4)
pointAtParameter_5 = Curve.PointAtParameter(curve=transpose_4)
code_block_22 = CodeBlock(c=transpose_4) { Math.Round(c.Length/100); }
pointsAtEqualChordLength = Curve.PointsAtEqualChordLength(transpose_4, code_block_22)
transpose_5 = List.Transpose(pointsAtEqualChordLength@L3)
byPoints_5 = PolyCurve.ByPoints(points=transpose_5)
XZ_5 = Plane.XZ()
code_block_23 = CodeBlock { 2; }
div = number_slider_baluster_cross / code_block_23
byPlaneRadius_3 = Circle.ByPlaneRadius(plane=XZ_5, radius=div)
coordinateSystemAtParameter_5 = Curve.CoordinateSystemAtParameter(translate_8)
transform_5 = Geometry.Transform(byPlaneRadius_3, coordinateSystemAtParameter_5)
sweepAsSolid_3 = Curve.SweepAsSolid(transform_5, translate_8)

# group: Arch Beams Input
number_slider_arch_beams_width = DoubleSlider(150, range=0..600 step 1)
number_slider_arch_beams_height = DoubleSlider(450, range=0..600 step 1)

# group: Arch Cross Section
XY = Plane.XY()
byWidthLength_3 = Rectangle.ByWidthLength(plane=XY, width=number_slider_arch_beams_width, length=number_slider_arch_beams_height)
coordinateSystemAtParameter_6 = Curve.CoordinateSystemAtParameter(trimByParameter, code_block_15, lacing=CrossProduct)
transform_6 = Geometry.Transform(byWidthLength_3, coordinateSystemAtParameter_6, lacing=CrossProduct)
transpose_6 = List.Transpose(transform_6)

byLoft_4 = Solid.ByLoft(transpose_6)
